# Grasshopper definition bake_attributes.gh (Grasshopper 1.0.7)

# ---- group: road import
load_road_shapefile = FilePath("C:\Dropbox\MIT\LOCAL\gh_ex\WEBSITE\bake_attributes\shapefiles\BASEMAP_Roads.shp")

# ---- group: load land import
load_land_use = FilePath("C:\Dropbox\MIT\LOCAL\gh_ex\WEBSITE\bake_attributes\shapefiles\CDD_LandUse_attributes.shp")

# ---- group: analysis boundary import
load_boundary_shapefile = FilePath("C:\Dropbox\MIT\LOCAL\gh_ex\WEBSITE\bake_attributes\shapefiles\MIT_buffer.shp")

# ----
toggle = BooleanToggle(True)

readshapefile = ReadShapefile(shapefile=load_land_use, Read=toggle)  # -> geometry, attributes, values
# ---------- readshapefile: Python ----------
"""Imports geometry from shapefile.

Directly imports SHP files and turns them into Grasshopper geometries.
Their GIS attributes are stored as User Strings in the geometry.
Based on the work of Jackie Berry.

    Typical usage:
        Get the location (Flie Path) of the SHPfile you want to import. The file path should include the name of the .shp file.
        Add two Boolean toggles. Plug them into the 'Read' and 'move To Center' inputs.
        When Read is set to True, the component will load the SHP file into GH. When moveToCenter is set to true, the SHP file geometries will be moved to the center of the Rhino Workspace, otherwise they'll be imported into their global projection.

    Inputs:
        shapefile: path to shapefile
        Read: boolean to run script
        moveToCenter: boolean to center imported geometry at origin

    Output:
        geometry: imported geometry from shapefile"""

__author__ = "palomagr"
__version__ = "2020.07.09"

#ghenv.Component.Name = "Read Shape File"
#ghenv.Component.NickName = "Read Shape File"


from ghpythonlib.componentbase import executingcomponent as component
import Grasshopper, GhPython, System, Rhino, os, sys, System.Text
import struct, datetime, decimal, itertools
import rhinoscriptsyntax as rs
from struct import unpack
bodyname = System.Text.Encoding.Default.BodyName
sys.setdefaultencoding(bodyname)
from Grasshopper.Kernel import GH_RuntimeMessageLevel as RML
import ghpythonlib.treehelpers as th

class MyComponent(component):

    def RunScript(self, shapefile, Read, moveToCenter):
        if shapefile == None:
            self.AddRuntimeMessage(RML.Warning, "Add a shapefile.")
        if Read == None:
            self.AddRuntimeMessage(RML.Warning, "Add a boolean toggle in the read input.")
        geometry, attributes, values =None, None, None

        def dbfreader(f):
            """Returns an iterator over records in a Xbase DBF file.

            The first row returned contains the field names.
            The second row contains field specs: (type, size, decimal places).
            Subsequent rows contain the data records.
            If a record is marked as deleted, it is skipped.

            File should be opened for binary reads.

            """
            # See DBF format spec at:
            #     http://www.pgts.com.au/download/public/xbase.htm#DBF_STRUCT

            numrec, lenheader = struct.unpack('<xxxxLH22x', f.read(32))
            numfields = (lenheader - 33) // 32

            fields = []
            for fieldno in xrange(numfields):
                name, typ, size, deci = struct.unpack('<11sc4xBB14x', f.read(32))
                name = name.replace('\0', '')       # eliminate NULs from string
                fields.append((name, typ, size, deci))
            yield [field[0] for field in fields]
            yield [tuple(field[1:]) for field in fields]

            terminator = f.read(1)
            assert terminator == '\r'

            fields.insert(0, ('DeletionFlag', 'C', 1, 0))
            fmt = ''.join(['%ds' % fieldinfo[2] for fieldinfo in fields])
            fmtsiz = struct.calcsize(fmt)
            for i in xrange(numrec):
                record = struct.unpack(fmt, f.read(fmtsiz))
                if record[0] != ' ':
                    continue                        # deleted record
                result = []
                for (name, typ, size, deci), value in itertools.izip(fields, record):
                    if name == 'DeletionFlag':
                        continue
                    if typ == "N":
                        value = value.replace('\0', '').lstrip()
                        if value == '':
                            value = 0
                        elif deci:
                            try: value = decimal.Decimal(value)
                            except: value = value
                        else:
                            try: value = int(value)
                            except: value = value
                    elif typ == 'D':
                        #print type(value[:4]), type(value[4:6]), type(value[6:8])
                        try:
                            y, m, d = int(value[:4]), int(value[4:6]), int(value[6:8])
                            value = datetime.date(y, m, d)
                        except:
                            value = None
                            self.AddRuntimeMessage(RML.Warning,"We couldn't get a date for a geometry in your dbf")
                    elif typ == 'L':
                        value = (value in 'YyTt' and 'T') or (value in 'NnFf' and 'F') or '?'
                    result.append(value)
                yield result

        ##########################################################################

        class ShpFeature(object):
            """
            This is a base class for each record in a shapefile.
            each record corresponds to one row in the shapefile's dbf table.
            To clarify the distinction between a feature and a record:
            the record is the feature + the dbf data associated with the feature
            the feature is shape (or multi-shape)
            In this class, I attach the dbf data for each record to it's feature.
            """

            def __init__(self, shpFile, recordNumber):
                self.shpFile = shpFile
                self.recordNumber = recordNumber
                self.shapeType = shpFile.shapeType
                self.dbfData = self.readDbfData()

            def readDbfData(self):
                db = self.shpFile.dbfTable
                dbfData = {}
                for i in range(len(db[0])): # for each column
                        dbfData[db[0][i]] = db[self.recordNumber + 2][i]
                return dbfData

            def make3D(self, zVals=None):
                """
                This method will take a list of z values and use them to create a new
                attribute called points3D, which contains 3d points. ESRI shapefiles
                place z values in a separate list form x and y values for each point,
                so this essentially integrates those values to make full 3d points.
                If the number of z values does not match the number of points,
                then this method will not work.
                This method will overwrite the points3d attribute if it already exists.
                """
                # if there's not enough z values for the number of points
                # or not enough points for the number of z values
                if not zVals:
                    try: zVals = [0 for i in range(self.numPoints)]
                    except:  print "This geometry has too many vertices, try simplyfying it"
                if len(zVals) != self.numPoints:
                    print "The number of Z values does not correspond to the number of points."
#                    self.AddRuntimeMessage(RML.Warning,"The number of Z values does not correspond to the number of points.")
                    return
                # clear points3D
                self.points3D = []
                for i in range(len(zVals)):
                    z = zVals[i]
                    x = self.points[i][0]
                    y = self.points[i][1]
                    point3d = (x,y,z)
                    self.points3D.append(point3d)

            def chopParts(self, partlist, pointlist):
                if type(partlist) == tuple:
                    indexSpread = list(partlist)
                elif type(partlist) == list:
                    indexSpread = partlist
                else:
                    indexSpread = [partlist]
                indexSpread.append(len(pointlist))
                chunks = []
                for i in range(len(indexSpread) - 1):
                    chunks.append(pointlist[indexSpread[i]:indexSpread[i+1]])
                return chunks

        class ShpPoint(ShpFeature):

            def __init__(self, ShpFile, recordNumber):
                ShpFeature.__init__(self, ShpFile, recordNumber)
                self.parts = [0]
                self.numParts = 1
                self.numPoints = 1
                self.points = [self.shpFile._readPoint()]
                self.x = self.points[0][0]
                self.y = self.points[0][1]
                self.make3D()

        class ShpPointM(ShpPoint):
            def __init__(self,ShpFile, recordNumber):

                ShpPoint.__init__(self, ShpFile, recordNumber)

                self.m = self.shpFile._readZ()
                self.make3D()

        class ShpPointZ(ShpPoint):
            def __init__(self,ShpFile, recordNumber):

                ShpPoint.__init__(self, ShpFile, recordNumber)

                self.z = self.shpFile._readZ()
                self.m = self.shpFile._readZ()
                self.make3D([self.z])

        class ShpMultiPoint(ShpFeature):

            def __init__(self,ShpFile, recordNumber):

                ShpFeature.__init__(self, ShpFile, recordNumber)
                self.parts[0]
                self.numParts = 1
                self.boundingBox = self.shpFile._readBoundingBox()
                self.numPoints = self.shpFile._readNumPoints()
                self.points = self.shpFile._readPoints(self.numPoints)
                self.make3D()

        class ShpMultiPointM(ShpMultiPoint):

            def __init__(self,ShpFile, recordNumber):

                ShpMultiPoint.__init__(self, ShpFile, recordNumber)
                self.mBounds = self.shpFile._readZBounds()
                self.mArray = self.shpFile._readZArray(self.numPoints)
                self.make3D()

        class ShpMultiPointZ(ShpMultiPoint):

            def __init__(self,ShpFile, recordNumber):

                ShpMultiPoint.__init__(self, ShpFile, recordNumber)
                self.zBounds = self.shpFile._readZBounds()
                self.zArray = self.shpFile._readZArray(self.numPoints)
                self.mBounds = self.shpFile._readZBounds()
                self.mArray = self.shpFile._readZArray(self.numPoints)
                self.make3D(self.zArray)

        class ShpPolyLine(ShpFeature):

            def __init__(self,ShpFile, recordNumber):

                ShpFeature.__init__(self, ShpFile, recordNumber)

                self.boundingBox = self.shpFile._readBoundingBox()
                self.numParts = self.shpFile._readNumParts()
                self.numPoints = self.shpFile._readNumPoints()
                self.parts = self.shpFile._readParts(self.numParts)
                self.points = self.shpFile._readPoints(self.numPoints)
                self.make3D()

        class ShpPolyLineM(ShpPolyLine):

            def __init__(self,ShpFile, recordNumber):

                ShpPolyLine.__init__(self, ShpFile, recordNumber)

                self.mBounds = self.shpFile._readZBounds()
                self.mArray = self.shpFile._readZArray(self.numPoints)
                self.make3D()

        class ShpPolyLineZ(ShpPolyLine):

            def __init__(self,ShpFile, recordNumber):

                ShpPolyLine.__init__(self, ShpFile, recordNumber)

                self.zBounds = self.shpFile._readZBounds()
                self.zArray = self.shpFile._readZArray(self.numPoints)
                self.mBounds = self.shpFile._readZBounds()
                self.mArray = self.shpFile._readZArray(self.numPoints)
                self.make3D(self.zArray)

        class ShpPolygon(ShpFeature):

            def __init__(self,ShpFile, recordNumber):

                ShpFeature.__init__(self, ShpFile, recordNumber)

                self.boundingBox = self.shpFile._readBoundingBox()
                self.numParts = self.shpFile._readNumParts()
                self.numPoints = self.shpFile._readNumPoints()
                self.parts = self.shpFile._readParts(self.numParts)
                self.points = self.shpFile._readPoints(self.numPoints)
                self.make3D()

        class ShpPolygonM(ShpPolygon):

            def __init__(self,ShpFile, recordNumber):

                ShpPolygon.__init__(self, ShpFile, recordNumber)

                self.mBounds = self.shpFile._readZBounds()
                self.mArray = self.shpFile._readZArray(self.numPoints)
                self.make3D()

        class ShpPolygonZ(ShpPolygon):

            def __init__(self,ShpFile, recordNumber):

                ShpPolygon.__init__(self, ShpFile, recordNumber)

                self.zBounds = self.shpFile._readZBounds()
                self.zArray = self.shpFile._readZArray(self.numPoints)
                self.mBounds = self.shpFile._readZBounds()
                self.mArray = self.shpFile._readZArray(self.numPoints)
                self.make3D(self.zArray)

        class ShpMultiPatch(ShpFeature):

            def __init__(self, ShpFile, recordNumber):

                ShpFeature.__init__(self, ShpFile, recordNumber)

                self.boundingBox = self.shpFile._readBoundingBox()
                self.numParts = self.shpFile._readNumParts()
                self.numPoints = self.shpFile._readNumPoints()
                self.parts = self.shpFile._readParts(self.numParts)
                self.partTypes = self.shpFile._readParts(self.numParts)
                self.points = self.shpFile._readPoints(self.numPoints)
                self.zBounds = self.shpFile._readZBounds()
                self.zArray = self.shpFile._readZArray(self.numPoints)
                self.mBounds = self.shpFile._readZBounds()
                self.mArray = self.shpFile._readZArray(self.numPoints)
                self.make3D(self.zArray)
                #self.points = [self.shpFile._readPoint()]

        ##################################################

        def readAndUnpack(type, data):
            if data=='': return data
            return unpack(type, data)[0]

        shapeTypeDict = {
                         0:'Null Shape',
                         1:'Point',
                         3:'PolyLine',
                         5:'Polygon',
                         8:'MultiPoint',
                         11:'PointZ',
                         13:'PolyLineZ',
                         15:'PolygonZ',
                         18:'MultiPointZ',
                         21:'PointM',
                         23:'PolyLineM',
                         25:'PolygonM',
                         28:'MultiPointM',
                         31:'MultiPatch'
                         }

        classTypeDict = {
                        'Point':ShpPoint,
                        'PointM':ShpPointM,
                        'PointZ':ShpPointZ,
                        'MultiPoint':ShpMultiPoint,
                        'MultiPointM':ShpMultiPointM,
                        'MultiPointZ':ShpMultiPointZ,
                        'PolyLine':ShpPolyLine,
                        'PolyLineM':ShpPolyLineM,
                        'PolyLineZ':ShpPolyLineZ,
                        'Polygon':ShpPolygon,
                        'PolygonM':ShpPolygonM,
                        'PolygonZ':ShpPolygonZ,
                        'MultiPatch':ShpMultiPatch
                        }


        class ShpFile(object):
            """
            This class is instantiated using the file path to a shapefile (must contain the .shp file extension), and as soon as it is instantiated, it reads the entire shapefile.
            Once instantiated, it contains objects for each feature based on shape type (the objects are accessible using the
            .records attribute), and allows access to the shapefile data at multiple levels.
            """

            def __init__(self,filePath):
                self.filePath = filePath
                self.proj = self._readProjText()
                self.dbfTable = self._readDbfTable()
                self.f = open(self.filePath, 'rb')
                header = self._readFileHeader()
                self.shapeType = header[0]
                self.boundingBox = header[1]
                self.records = self._readRecords()
                self.f.close()

            def _readBoundingBox(self):
                xMin = readAndUnpack('d', self.f.read(8))
                yMin = readAndUnpack('d', self.f.read(8))
                xMax = readAndUnpack('d', self.f.read(8))
                yMax = readAndUnpack('d', self.f.read(8))
                bbox = (xMin, yMin, xMax, yMax)
                return bbox

            def _readProjText(self):
                projPath = self.filePath[0:-4] + '.prj'
                f = open(projPath, 'r')
                s = f.read()
                return s


            def _readFileHeader(self):
                self.f.seek(32)
                shapeKey = readAndUnpack('i', self.f.read(4))
                shapeType = shapeTypeDict[shapeKey]
                boundingBox = self._readBoundingBox()
                return (shapeType, boundingBox)

            def _readPoint(self):
                x = readAndUnpack('d', self.f.read(8))
                y = readAndUnpack('d', self.f.read(8))
                return (x,y)

            def _readNumParts(self):
                return readAndUnpack('i', self.f.read(4))

            def _readNumPoints(self):
                return readAndUnpack('i', self.f.read(4))

            def _readParts(self, numParts):
                partIndices = []
                try:
                    for i in range(numParts):
                        partIndex = readAndUnpack('i', self.f.read(4))
                        partIndices.append(partIndex)
                    return partIndices
                except: print "This geometry has too many vertices, try simplyfying it"

            def _readPoints(self, numPoints):
                points = []
                # I removed a short chunk of code here
                # that was used to remove any two identical
                # consecutive points. Such a check is only relevant if
                # each part is being checked separately, otherwise
                # a part that begins where the other left off would be
                # messed up.
                try:
                    for i in range(numPoints):
                        point = self._readPoint()
                        points.append(point)
                    return points
                except: print "This geometry has too many vertices, try simplyfying it"

            def _readZ(self):
                z = readAndUnpack('d', self.f.read(8))
                return z

            def _readZBounds(self):
                zMin = self._readZ()
                zMax = self._readZ()
                return (zMin,zMax)

            def _readZArray(self, numPoints):
                zArray = []
                for i in range(numPoints):
                    z = self._readZ()
                    zArray.append(z)
                return zArray

            def setZfield(self, fieldKey=None, zValue=0.0):
                # this method will erase any existing
                # z data of the geometry
                # and will replace it with values
                # from the field designated
                # by the fieldKey
                zValue = 0.0
                for record in self.records:
                    if fieldKey != None:
                        try:
                            zValue = float(record.dbfData[fieldKey])
                        except:
                            print 'There is no field by that name in the table'
                            self.AddRuntimeMessage(RML.Warning,"There is no field by that name in the table")
                            return
                    zArray = []
                    for each in range(record.numPoints):
                        zArray.append(zValue)
                    record.make3D(zArray)

            def _readDbfTable(self):
                dbfFile = self.filePath[0:-4] + '.dbf'
                dbf = open(dbfFile, 'rb')
                db = list(dbfreader(dbf))
                dbf.close()
                return db

            def _readRecords(self):
                records = []
                self.f.seek(100)
                iterator = 0
                while True:
                    record = self._readFeature(iterator)
                    if record == False:
                            break
                    records.append(record)
                    iterator += 1
                return records

            def _readFeature(self, iterator):
                # the next 12 bytes are simply passed over, though they contain:
                # a record number: which doesn't seem to correspond to the dbf
                # a content length integer
                # a shapeType integer, which is never different form the shapeType of the file
                read = self.f.read(12)
                if read == '':
                        # signifies end of shapefile
                        return False
                else:
                    # get shapeType and creates appropriate feature
                    feature = classTypeDict[self.shapeType](self,iterator)
                    return feature

        def tVect(geom, vector):
            geom.Translate(vector)
            geom.SetUserString('TranslationVector', str(vector) )
            return geom

        def transVectorFromBBox(shpFile):
            """Uses the bounding box of a shapefile to make a vector moving Rhino geometry to the origin. The translation vector
            can also be stored as a user string the Rhino geometry, for later conversion back into geospatial data."""
            b = shpFile.boundingBox
            originalCenterPoint = ((b[0]+b[2])/2, (b[1]+b[3])/2, 0.0)
            translationVectr = Rhino.Geometry.Vector3d((b[0]+b[2])/-2.0, (b[1]+b[3])/-2.0, 0.0)
            return translationVectr

        def chop(indices, someList):
            for i in range(len(indices)-1):
                idx1, idx2 = indices[i], indices[i+1]
                yield someList[idx1:idx2]

        def chopPoints( feature ):
            if feature.numParts > 1:
                return [p for p in chop(feature.parts, feature.points3D)]
            else:
                return [feature.points3D]

        def shpToPoints( feature, translationVector=None ):
            points = [Rhino.Geometry.Point3d(*p) for p in feature.points3D]
            vals = feature.dbfData.values()

#            points = [Rhino.Geometry.Point3d(p[0],p[1],p[2]) for p in feature.points3D]
            if translationVector:
                points = [p.Add(p, translationVector) for p in points]
            return [points, vals]

        def shpToCurve( feature, translationVector=None, degree=1):
            parts = chopPoints( feature )
            crvs = []
            vals = feature.dbfData.values()
            for part in parts:
                points = []
                for pt in part:
                    rhPoint = Rhino.Geometry.Point3d( *pt )
                    points.append( rhPoint )
                crv = Rhino.Geometry.Curve.CreateControlPointCurve( points, degree )
                if translationVector:
                    crv = tVect(crv, translationVector )
                crvs.append( crv )
            return [crvs, vals]

        def shpToMesh( multiPatchFeature, translationVector=None ):
            m = multiPatchFeature
            parts = chopPoints(m)
            mesh = Rhino.Geometry.Mesh()
            vals = multiPatchFeature.dbfData.values()
            for i, points in enumerate(parts):
                if m.partTypes[i] == 0: # it's a a triangle strip
                    submesh = Rhino.Geometry.Mesh()
                    for j, pt in enumerate(points): # build vertices
                        rhPoint = Rhino.Geometry.Point3d(*pt)
                        submesh.Vertices.Add(rhPoint)
                    for n in range(len(points)-1):
                        submesh.Faces.AddFace(n, n +1, n +2 )
                    submesh.Normals.ComputeNormals()
                    submesh.Compact()
                    mesh.Append(submesh)
                else: # it's some other geometry
                    self.AddRuntimeMessage(RML.Error,"This geometry type is not yet supported, sorry.")
                    return 'This geometry type is not yet supported, sorry.'
            mesh.UnifyNormals()
            mesh.Normals.ComputeNormals()
            mesh.Compact() # mesh all fresh and ready!
            if translationVector:
                mesh = tVect( mesh, translationVector)
            return [[ mesh ], vals]



        translationDict = {
                           'Point':shpToPoints,
                           'Polygon':shpToCurve,
                           'PolyLine':shpToCurve,
                           'PolyLineZ':shpToCurve,
                           'PolygonZ':shpToCurve,
                           'MultiPatch':shpToMesh
                           }

        def ShpFileToRhino( filepath, zero=True, tVect=None ):
            shpfile = ShpFile( filepath )
            if zero:
                tVect = transVectorFromBBox( shpfile )
            records = shpfile.records
            geoms = []
            values = []
            for r in records:
                new_record =  translationDict[ shpfile.shapeType ]( r, tVect )
                geoms.extend(new_record[0])
                values.append(new_record[1])
            return [geoms, records[0].dbfData.keys(), values]

        ##################################################

        if Read:
            if shapefile:
                if not os.path.exists(shapefile):
                    self.AddRuntimeMessage(RML.Error,"The shapefile you gave me does not exist.\nDouble check the path: '%s'" % shapefile)
                    print 'The shapefile you gave me does not exist.\nDouble check the path: "%s"' % shapefile
                # import stuff
                out = ShpFileToRhino( shapefile, moveToCenter )
                geometry = out[0]
                attributes = out[1]
                values = th.list_to_tree(out[2], source=[0,0])
            else:
                print 'no shapefile supplied'

        # return outputs if you have them; here I try it for you:
        return (geometry, attributes, values)
# ---------- end readshapefile ----------

readshapefile_2 = ReadShapefile(shapefile=load_boundary_shapefile, Read=toggle)  # -> geometry, attributes, values; same code as readshapefile

readshapefile_3 = ReadShapefile(shapefile=load_road_shapefile, Read=toggle)  # -> geometry, attributes, values; same code as readshapefile

# ---- group: making surfaces for blocks
boundary = BoundarySurfaces(Edges=readshapefile_3.geometry)
boundary_2 = BoundarySurfaces(Edges=readshapefile_2.geometry)
sdiff = SolidDifference(BrepsA=boundary_2, BrepsB=boundary)

# ---- group: land use zones
area = Area(Geometry=readshapefile_2.geometry)  # -> Area, Centroid
project = Project(Geometry=readshapefile.geometry, Plane=area.Centroid)  # -> graft(Geometry), Transform
boundary_3 = BoundarySurfaces(Edges=project.Geometry)
Z = UnitZ(Factor=1)
zones = Extrude(Base=boundary_3, Direction=Z)

# ---- group: land uses
flip = FlipMatrix(Data=readshapefile.attributes)
item = ListItem(List=flip, Index=0, Wrap=True)  # -> flatten(Item)
item_2 = ListItem(List=readshapefile.values, Index=Slider(1, range=0..15), Wrap=True)
panel = Panel(item)

# ---- group: extruding blocks
curb_height = Slider(6, range=0..10)
Z_2 = UnitZ(Factor=curb_height)
blocks = Extrude(Base=sdiff, Direction=Z_2)

# ---- group: get unique uses
tsort = SortText(Keys=flatten(item_2), Culture=127)  # -> Keys, Values
dcon = DeleteConsecutive(Set=tsort.Keys, Wrap=False)  # -> Set, Count

# ---- group: random color layers by count of land uses
lng = ListLength(List=flatten(dcon.Set))
wheel = ColourWheel(
    lng,
    ColourGrips_Style=31,
    ColourGrips_Grip=[4.844360838, 0.655570633, 2.749965735, 1.702768184],
    ColourGrips_Lum=[0.4034294689, 1],
    ColourGrips_Range=[0.9566031034, 0.9566031034, 0.9566031034, 0.9566031034],
    ColourGrips_Sat=[0.4619201174, 1])

# ---- group: zones organized by use
mindex = MemberIndex(Set=flatten(item_2), Member=graft(dcon.Set))  # -> Index, Count
item_3 = ListItem(List=flatten(zones), Index=mindex.Index, Wrap=True)  # -> simplify(Item)

# ----
entwine = Entwine(Branch00=blocks, Branch01=boundary, FlattenInputs=True)

# ---- group: BAKE WITH ATTRIBUTES - zones
toggle_2 = BooleanToggle(False)
bake_with_attributes = GhPythonScript(geometry=item_3, layers=dcon.Set, colors=wheel, delete=toggle_2, group=Toggle(True), Bake=toggle_2)  # inputs geometry: tree, layers: list, colors: list, widths: list, materials: list
# ---------- bake_with_attributes: Python ----------
"""Bakes geometry with attributes into Rhino.

The geometry is baked by branch into specific layers.
Geometry objects can have colors, widths, and materials as attributes.
You can group the baked objects and delete all the previous instances of the objects.

    Typical usage example:
        Input geometry an separate (graph) them into branches of a data tree.
        Provide a list of layer names to each branch that will be baked. Input all the desired attributes.
        Use a 'make Material' LocalCode component to make and assign a material to each layer.
        Toggle the 'Bake' boolean to activate the component.

    Inputs:
        geometry: Geometry as a tree of objects
        layers: Layer names as a list of strings
        colors: Color swatches as a list
        widths: List of floats
        materials: List of LocalCode Materials
        delete: Boolean to delete 'EVERY' previous instance of the geometry
        group: Boolean to group all objects
        Bake: Boolean that bakes the geometry with attributes into Rhino

    Outputs:
        None"""

__author__ = "palomagr"
__version__ = "2020.07.09"

# ghenv.Component.Name = "Bake with Attributes"
# ghenv.Component.NickName = "Bake with Attributes"


from ghpythonlib.componentbase import executingcomponent as component
import Grasshopper, GhPython
import System, Rhino, os
import rhinoscriptsyntax as rs
import ghpythonlib.treehelpers as th
import ghpythonlib.components as ghcomp
import scriptcontext as sc
from Grasshopper.Kernel import GH_RuntimeMessageLevel as RML

class MyComponent(component):
    
    def RunScript(self, geometry, layers, colors, widths, materials, delete, group, Bake):
        #Call rhino document 
        rcdoc = Rhino.RhinoDoc.ActiveDoc
        #Make a list of the geometry branches
        geometryList = [geometry.Branch(b) for b in range(geometry.BranchCount)]
        #Check if the number of layers is the same as the branches
        if geometry == None:
            self.AddRuntimeMessage(RML.Warning, "Add geometry in branches.")
        if Bake == None:
            self.AddRuntimeMessage(RML.Warning, "Add a boolean toggle in the Bake input.")
        if len(layers) != geometry.BranchCount:
            self.AddRuntimeMessage(RML.Warning, "Add the same number of geometry branches and layers.")
            
        if Bake:
            
            if delete:
               for i in range(len(layers)):
                currentLayer = layers[i].strip()
                sc.doc = rcdoc
                if rs.IsLayer(currentLayer):
                    allObjs_l = rs.ObjectsByLayer(currentLayer)
                    print(len(allObjs_l))
                    rs.DeleteObjects(allObjs_l)
                sc.doc = ghdoc
                    
            num = len(geometryList)
            for i in range(num):
                currentLayer = layers[i].strip()
                if colors != [] and len(colors) == num:
                    currentColor = colors[i]
                else:
                    currentColor = [0,0,0] 
                if materials != [] and len(materials) == num:
                    currentMaterial  = materials[i]
                else: 
                    currentMaterial = None
                if widths != [] and len(widths) == num:
                    currentWidth = widths[i]
                else: currentWidth = 1.0
                                
                for id in geometryList[i]:
                    sc.doc = ghdoc
                    gh_to_rhino = rs.coercerhinoobject(id)                
                    attributes = gh_to_rhino.Attributes
                    geometryObj = gh_to_rhino.Geometry
                    sc.doc = Rhino.RhinoDoc.ActiveDoc #we change the scriptcontext           
                    rhino_brep = sc.doc.Objects.Add(geometryObj, attributes)#we add both the geometry and the attributes to the Rhino doc
                    if(group):
                        name = rs.AddGroup('bake_group')
                        rs.AddObjectToGroup(rhino_brep, 'bake_group')
                
                    if not rs.IsLayer(currentLayer) and currentColor != None:
                            rs.AddLayer(name=currentLayer)
                            
                    prevColor = rs.LayerColor(layer=currentLayer)
                    if prevColor != currentColor: 
                        rs.LayerColor(currentLayer, color = currentColor)           
                
                    index = rs.LayerOrder(currentLayer)
                    if currentMaterial != None:
                        #print(currentMaterial.Name) 
                        sc.doc.RenderMaterials.Add(currentMaterial)                    
                        sc.doc.Layers[index].RenderMaterial = currentMaterial
                                        
                    rs.LayerPrintWidth(currentLayer, float(currentWidth))     
                    rs.ObjectLayer(rhino_brep, currentLayer) # add objects to rhino layer                    
        sc.doc = ghdoc #we put back the original Grasshopper document as default
                
                                    
                
                
        
        # return outputs if you have them; here I try it for you:
        return
# ---------- end bake_with_attributes ----------

# ---- group: bake with attributes - streets and blocks
bake_with_attributes_2 = GhPythonScript(geometry=entwine, layers=["streets", "blocks"], delete=toggle_2, group=Toggle(False), Bake=toggle_2)  # inputs geometry: tree, layers: list, colors: list, widths: list, materials: list; same code as bake_with_attributes
