# Grasshopper definition batch_export.gh (Grasshopper 1.0.7)
# plug-ins: SelectLayerfromGeoJSON

# ---- group: layer names
panel = Panel("buildings")
panel_2 = Panel("blocks")
panel_3 = Panel("streets")

# ---- group: batch export / file name
panel_4 = Panel("cambridge_piece_3d.AI")

# ---- group: batch export / export
toggle = BooleanToggle(False)
toggle_2 = BooleanToggle(False)

# ----
toggle_3 = BooleanToggle(True)
merge_layer_names = Merge(Data1=panel, Data2=panel_2, Data3=panel_3)

load_footprint_shapefile = FilePath("C:\Dropbox\MIT\LOCAL\gh_ex\working\batch_export\shapefiles\BASEMAP_Buildings.shp")
readshapefile = ReadShapefile(shapefile=load_footprint_shapefile, Read=toggle_3)  # -> Geometry, Attributes, Values

load_boundary_shapefile = FilePath("C:\Dropbox\MIT\LOCAL\gh_ex\working\bake_attributes\shapefiles\MIT_buffer.shp")
readshapefile_2 = ReadShapefile(shapefile=load_boundary_shapefile, Read=toggle_3)  # -> Geometry, Attributes, Values

load_road_shapefile = FilePath("C:\Dropbox\MIT\LOCAL\gh_ex\working\bake_attributes\shapefiles\BASEMAP_Roads.shp")
readshapefile_3 = ReadShapefile(shapefile=load_road_shapefile, Read=toggle_3)  # -> Geometry, Attributes, Values

# ---- group: making surfaces for blocks
boundary = BoundarySurfaces(Edges=flatten(readshapefile_3.Geometry))
boundary_2 = BoundarySurfaces(Edges=readshapefile_2.Geometry)
sdiff = SolidDifference(BrepsA=boundary_2, BrepsB=boundary)

# ---- group: extracting height parameter
flip = FlipMatrix(Data=readshapefile.Attributes)
item = ListItem(List=flip, Index=0, Wrap=True)  # -> flatten(Item)
panel_5 = Panel(item)
item_2 = ListItem(List=readshapefile.Values, Index=Slider(7, range=0..10), Wrap=True)

# ---- group: project footprint and extrude buildings
project = Project(Geometry=readshapefile.Geometry, Plane=PlaneXY(0, 0, 0))  # -> Geometry, Transform
boundary_3 = BoundarySurfaces(Edges=project.Geometry)
Z = UnitZ(Factor=item_2)
buildings = Extrude(Base=boundary_3, Direction=Z)

# ---- group: extruding blocks
curb_height = Slider(6, range=0..10)
Z_2 = UnitZ(Factor=curb_height)
blocks = Extrude(Base=sdiff, Direction=Z_2)

# ----
streets = Surface(boundary)

# ---- group: random color layers by count of layer names
lng = ListLength(List=merge_layer_names)
wheel = ColourWheel(
    lng,
    ColourGrips_Style=31,
    ColourGrips_Grip=[0, 2.094395102, 4.188790205, 3.141592654],
    ColourGrips_Lum=[0.1, 0.5],
    ColourGrips_Range=[0.2617993878, 0.2617993878, 0.2617993878, 0.2617993878],
    ColourGrips_Sat=[0.2, 0.6])

# ---- group: geometry in branches
entwine = Entwine(Branch00=buildings, Branch01=blocks, Branch02=streets, FlattenInputs=True)

# ---- group: batch export
path = FilePath("C:\Dropbox\MIT\LOCAL\gh_ex\working\batch_export\")
batchexport = BatchExport(
    geometry=entwine,
    exportFileName=panel_4,
    exportFilePath=path,
    layerNames=merge_layer_names,
    layerColors=wheel,
    Export=toggle,
    deleteExisting=toggle_2)
