# Grasshopper definition batch_import.gh (Grasshopper 1.0.7)
# plug-ins: SelectLayerfromGeoJSON

# ---- group: file name
panel = Panel("cambridge_piece_3d_rhino.3dm")

# ----
path = FilePath("C:\Dropbox\MIT\LOCAL\gh_ex\working\batch_import\")
batchimport = BatchImport(filenames=panel, sourceFolderPath=path, Import=Toggle(True), deleteExisting=Toggle(True))  # -> GeometryOut, Status
