# Grasshopper definition compare_attributes.gh (Grasshopper 1.0.7)
# plug-ins: SelectLayerfromGeoJSON

# ---- group: import landuse
load_landuse_shapefile = FilePath("C:\Dropbox\MIT\LOCAL\gh_ex\working\compare_attributes\shapefiles\CDD_LandUse_attributes.shp")
toggle = BooleanToggle(True)

# ----
readshapefile = ReadShapefile(shapefile=load_landuse_shapefile, Read=toggle)  # -> Geometry, Attributes, Values

# ---- group: land use cathegories list
item = ListItem(List=readshapefile.Values, Index=Slider(1, range=0..100), Wrap=True)
panel = Panel(item)
tsort = SortText(Keys=flatten(panel), Culture=127)  # -> Keys, Values
panel_2 = Panel(tsort.Keys)
dcon = DeleteConsecutive(Set=panel_2, Wrap=False)  # -> Set, Count
panel_3 = Panel(dcon.Set)

# ---- group: CHECK INDEX
flip = FlipMatrix(Data=readshapefile.Attributes)
item_2 = ListItem(List=flip, Index=0, Wrap=True)  # -> flatten(Item)
panel_4 = Panel(item_2)

# ---- group: get use: higher education
item_3 = ListItem(List=dcon.Set, Index=Slider(5, range=0..10), Wrap=True)
panel_5 = Panel(item_3)

# ---- group: compare and select parcels
comparegisattributes = CompareGISAttributes(AttributeList=item, AttributeName=item_3)
higher_education_use_parcels = CullPattern(List=readshapefile.Geometry, CullPattern=comparegisattributes)
crv = Curve(higher_education_use_parcels)
