# Grasshopper definition create_set_view.gh (Grasshopper 1.0.7)
# plug-ins: SelectLayerfromGeoJSON

geo = Geometry([<brep referenced from the Rhino model> x294])
createview = CreateView(MarshallingSignalParameter=geo, Azimuth=Slider(90, range=0..100), Altitude=Slider(90, range=0..100))  # -> View_geom, View_target, View_vector
setview = SetView(setView=Toggle(True), geometry=createview.View_geom, target=createview.View_target, vector=createview.View_vector)
