# Grasshopper definition geojson.gh (Grasshopper 1.0.7)
# plug-ins: SelectLayerfromGeoJSON

path = FilePath("C:\Dropbox\MIT\LOCAL\gh_ex\working\geojson_layer\02.test\")
importgeojson = ImportGeoJSON(Import=Toggle(True), MarshallingSignalParameter=path, SiteNumber=Slider(1, range=0..1))  # -> Geometry, Attributes, Values, LayerNames
selectlayerfromgeojson = SelectLayerfromGeoJSON(
    LayerNumber=Slider(1, range=0..1),
    Geometry=importgeojson.Geometry,
    Attributes=importgeojson.Attributes,
    Values=importgeojson.Values,
    LayerNames=importgeojson.LayerNames)  # -> LayerGeometry, LayerAttributes, LayerValues, LayerName
