# Grasshopper definition geojson_pack.gh (Grasshopper 1.0.7)
# plug-ins: atit, LunchBox, SetView

path = FilePath("G:\Dropbox\MIT\S02\Studio NY Squares\shapes\top_10_business_legend.shp")
toggle = BooleanToggle(True)
imp_it = ImpIt(ShapefileShpPath=path, Project2WGS84=False, TrueOrFalse=toggle)  # -> Shapes, Features
datavis_it = DataVisIt(Shapes=imp_it.Shapes, GetValueofFeature=imp_it.Features, TrueOrFalse=toggle)  # -> Polygon, Polyline, Point, AttValues
pt = Point(datavis_it.Point)
toggle_2 = BooleanToggle(True)
importgeojson = ImportGeoJSON(
    Import=Toggle(True),
    MarshallingSignalParameter="G:\Dropbox\MIT\LOCAL\gh_ex\geojson_pack\NY_test_current\",
    SiteNumber=Slider(28, range=1..76))  # -> Geometry, Attributes, Values, LayerNames
path_2 = FilePath("G:\Dropbox\MIT\S02\Studio NY Squares\shapes\census_reprojected.shp")
hull = ConvexHull(Points=flatten(pt), Plane=PlaneXY(0, 0, 0))  # -> Hull, HullZ, Indices
number_slider = Slider(6000, range=0..10000)
area = Area(Geometry=hull.Hull)  # -> Area, Centroid
imp_it_2 = ImpIt(ShapefileShpPath=path_2, Project2WGS84=False, TrueOrFalse=toggle_2)  # -> Shapes, Features
cir = Circle(Plane=area.Centroid, Radius=number_slider)
datavis_it_2 = DataVisIt(Shapes=imp_it_2.Shapes, GetValueofFeature=imp_it_2.Features, TrueOrFalse=toggle_2)  # -> Polygon, Polyline, Point, AttValues
incurve = PointInCurve(Point=datavis_it.Point, Curve=cir)  # -> Relationship, Point
smaller = SmallerThan(FirstNumber=Slider(1, range=0..1), SecondNumber=incurve.Relationship)  # -> SmallerThan, OrEqualTo
area_2 = Area(Geometry=datavis_it_2.Polygon)  # -> Area, Centroid
crv = Curve(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)
item = ListItem(List=datavis_it.AttValues, Index=Slider(24, range=0..24), Wrap=True)
item_2 = ListItem(List=datavis_it_2.AttValues, Index=Slider(25, range=0..100), Wrap=True)
incurve_2 = PointInCurve(Point=area_2.Centroid, Curve=crv)  # -> Relationship, Point
panel = Panel(datavis_it.AttValues)
cull = CullPattern(List=pt, CullPattern=smaller.OrEqualTo)
cull_2 = CullPattern(List=item, CullPattern=smaller.OrEqualTo)
smaller_2 = SmallerThan(FirstNumber=Slider(1, range=0..1), SecondNumber=incurve_2.Relationship)  # -> SmallerThan, OrEqualTo
total_pop = CullPattern(List=item_2, CullPattern=smaller_2.SmallerThan)
rad = Radians(Degrees=Slider(270, range=0..1000))
rad_2 = Radians(Degrees=Slider(90, range=0..100))
cull_3 = CullPattern(List=datavis_it_2.Polygon, CullPattern=smaller_2.SmallerThan)
panel_2 = Panel(cull_2)
bnd = Bounds(Numbers=flatten(total_pop))
dom = ConstructDomain(DomainStart=rad, DomainEnd=rad_2)
boundary = BoundarySurfaces(Edges=cull_3)
dom_2 = ConstructDomain(DomainStart=Slider(0, range=0..100), DomainEnd=Slider(500, range=0..10000))
area_3 = Area(Geometry=boundary)  # -> Area, Centroid
remap = RemapNumbers(Value=total_pop, Source=bnd, Target=dom_2)  # -> Mapped, Clipped
arc = Arc(Plane=area.Centroid, Radius=expr("x+1000", number_slider), Angle=dom)  # -> Arc, Length
sort_val = SortDuplicateValues(ValueList=flatten(panel_2))  # -> UniqueValues, Indices
division = Division(A=Slider(360, range=0..1000), B=total_pop)
white = ListItem(List=datavis_it_2.AttValues, Index=Slider(26, range=0..100), Wrap=True)
black = ListItem(List=datavis_it_2.AttValues, Index=Slider(27, range=0..100), Wrap=True)
asian = ListItem(List=datavis_it_2.AttValues, Index=Slider(29, range=0..100), Wrap=True)
lng = ListLength(List=sort_val.Indices)
cull_4 = CullPattern(List=white, CullPattern=smaller_2.SmallerThan)
cull_5 = CullPattern(List=black, CullPattern=smaller_2.SmallerThan)
cull_6 = CullPattern(List=asian, CullPattern=smaller_2.SmallerThan)
ma = MassAddition(Input=flatten(lng))  # -> Result, PartialResults
multiplication = Multiplication(A=cull_4, B=division)
multiplication_2 = Multiplication(A=cull_5, B=division)
multiplication_3 = Multiplication(A=cull_6, B=division)
divide = DivideCurve(Curve=arc.Arc, Count=ma.Result, Kinks=False)  # -> Points, Tangents, Parameters
mindex = MemberIndex(Set=flatten(cull_2), Member=sort_val.UniqueValues)  # -> Index, Count
rad_3 = Radians(Degrees=multiplication_3)
rad_4 = Radians(Degrees=multiplication)
rad_5 = Radians(Degrees=multiplication_2)
shatter = Shatter(Curve=arc.Arc, Parameters=divide.Parameters)
panel_3 = Panel("""25 ethnicity total
26 white
27 black
28 indian
29 asian""")
item_3 = ListItem(List=flatten(cull), Index=mindex.Index, Wrap=True)
number_slider_2 = Slider(10, range=0..10)
eval = EvaluateLength(Curve=shatter, Length=Slider(0.5, range=0..1), Normalized=True)  # -> Point, Tangent, Parameter
ln = Line(StartPoint=eval.Point, EndPoint=flatten(item_3))
lng_2 = ListLength(List=sort_val.UniqueValues)
Z = UnitZ(Factor=number_slider_2)
cir_2 = Circle(Plane=area_3.Centroid, Radius=remap.Mapped)
wheel = ColourWheel(
    lng_2,
    ColourGrips_Style=41,
    ColourGrips_Grip=[2.92647198, 6.068064633, 4.497268306, 1.355675653],
    ColourGrips_Lum=[0.4891427296, 0.5598753958],
    ColourGrips_Range=[0.7524407932, 0.7524407932, 0.7524407932, 0.7524407932],
    ColourGrips_Sat=[0.6565858014, 0.8301930312])
unflatten = UnflattenTree(Tree=ln, Guide=item_3)
move = Move(Geometry=item_3, Motion=Z)  # -> Geometry, Transform
cir_3 = Circle(Plane=item_3, Radius=number_slider_2)
ln_2 = Line(StartPoint=item_3, EndPoint=move.Geometry)
bake = ObjectBake(
    BakeToggle=Toggle(False),
    GeometryObjects=ln_2,
    Layer=graft(sort_val.UniqueValues),
    ObjectName="GH_Obj",
    ObjectColor=RGB(255, 255, 255),
    LayerColor=graft(wheel))

white_2 = Arc(Plane=area_3.Centroid, Radius=remap.Mapped, Angle=rad_4)  # -> Arc, Length
end = EndPoints(Curve=white_2.Arc)  # -> Start, End

# ---- group: black
darc = DeconstructArc(Arc=white_2.Arc)  # -> BasePlane, Radius, Angle
dedomain = DeconstructDomain(Domain=darc.Angle)  # -> Start, End
addition = Addition(A=dedomain.End, B=rad_5)
dom_3 = ConstructDomain(DomainStart=dedomain.End, DomainEnd=addition)
arc_2 = Arc(Plane=area_3.Centroid, Radius=remap.Mapped, Angle=dom_3)  # -> Arc, Length

# ---- group: asian
darc_2 = DeconstructArc(Arc=arc_2.Arc)  # -> BasePlane, Radius, Angle
dedomain_2 = DeconstructDomain(Domain=darc_2.Angle)  # -> Start, End
addition_2 = Addition(A=dedomain_2.End, B=rad_3)
dom_4 = ConstructDomain(DomainStart=dedomain_2.End, DomainEnd=addition_2)
arc_3 = Arc(Plane=area_3.Centroid, Radius=remap.Mapped, Angle=dom_4)  # -> Arc, Length

# ----
ln_3 = Line(StartPoint=end.Start, EndPoint=darc.BasePlane)
ln_4 = Line(StartPoint=end.End, EndPoint=darc.BasePlane)
white_slice = EdgeSurface(CurveA=white_2.Arc, CurveB=ln_3, CurveC=ln_4)

crv_2 = Curve(flatten(white_slice))
join = JoinCurves(Curves=crv_2, Preserve=False)

darc_3 = DeconstructArc(Arc=arc_2.Arc)  # -> BasePlane, Radius, Angle
end_2 = EndPoints(Curve=arc_2.Arc)  # -> Start, End
center = Point(darc_3.BasePlane)
ln_5 = Line(StartPoint=center, EndPoint=end_2.Start)
ln_6 = Line(StartPoint=center, EndPoint=end_2.End)
black_slice = EdgeSurface(CurveA=arc_2.Arc, CurveB=ln_5, CurveC=ln_6)

darc_4 = DeconstructArc(Arc=arc_3.Arc)  # -> BasePlane, Radius, Angle
end_3 = EndPoints(Curve=arc_3.Arc)  # -> Start, End
center_2 = Point(darc_4.BasePlane)
ln_7 = Line(StartPoint=center_2, EndPoint=end_3.Start)
ln_8 = Line(StartPoint=center_2, EndPoint=end_3.End)
asian_slice = EdgeSurface(CurveA=arc_3.Arc, CurveB=ln_7, CurveC=ln_8)

crv_3 = Curve(black_slice)
join_2 = JoinCurves(Curves=flatten(crv_3), Preserve=False)
crv_4 = Curve(flatten(asian_slice))
join_3 = JoinCurves(Curves=crv_4, Preserve=False)
