# Grasshopper definition make_material.gh (Grasshopper 1.0.7)
# plug-ins: SelectLayerfromGeoJSON

# ---- group: import buildings
load_footprint_shapefile = FilePath("C:\Dropbox\MIT\LOCAL\gh_ex\working\make_material\shapefiles\BASEMAP_Buildings.shp")

# ---- group: import boundary
load_boundary_shapefile = FilePath("C:\Dropbox\MIT\LOCAL\gh_ex\working\make_material\shapefiles\MIT_buffer.shp")

# ---- group: import streets
load_road_shapefile = FilePath("C:\Dropbox\MIT\LOCAL\gh_ex\working\make_material\shapefiles\BASEMAP_Roads.shp")

# ---- group: layer names
panel = Panel("buildings")
panel_2 = Panel("blocks")
panel_3 = Panel("streets")

# ---- group: random color layers by count of layer names
lng = ListLength(List=[panel, panel_2, panel_3])
wheel = ColourWheel(
    lng,
    ColourGrips_Style=21,
    ColourGrips_Grip=[5.054542021, 1.912949368, 0.3421530408, 3.483745694],
    ColourGrips_Lum=[0.1, 0.5],
    ColourGrips_Range=[0.2617993878, 0.2617993878, 0.2617993878, 0.2617993878],
    ColourGrips_Sat=[0.2, 0.6])

# ---- group: material configuration
number_slider = Slider(0.5, range=0..1)
number_slider_2 = Slider(0, range=0..1)
number_slider_3 = Slider(0, range=0..1)
swatch = ColourSwatch(SwatchColor=RGB(138, 228, 235))
data = Data([panel, panel_2, panel_3])
toggle = BooleanToggle(True)

# ---- group: make material
makematerial = MakeMaterial(
    Name=data,
    diffuseColor=wheel,
    specularColor=swatch,
    transparency=number_slider_2,
    reflection=number_slider_3,
    glossiness=number_slider,
    Make=toggle)  # -> Material, GHMaterial

# ----
toggle_2 = BooleanToggle(True)

readshapefile = ReadShapefile(shapefile=load_footprint_shapefile, Read=toggle_2)  # -> Geometry, Attributes, Values

readshapefile_2 = ReadShapefile(shapefile=load_road_shapefile, Read=toggle_2)  # -> Geometry, Attributes, Values

readshapefile_3 = ReadShapefile(shapefile=load_boundary_shapefile, Read=toggle_2)  # -> Geometry, Attributes, Values

# ---- group: making surfaces for blocks
boundary = BoundarySurfaces(Edges=readshapefile_3.Geometry)
boundary_2 = BoundarySurfaces(Edges=readshapefile_2.Geometry)
sdiff = SolidDifference(BrepsA=boundary, BrepsB=boundary_2)

# ---- group: extracting height parameter
flip = FlipMatrix(Data=readshapefile.Attributes)
item = ListItem(List=flip, Index=0, Wrap=True)  # -> flatten(Item)
item_2 = ListItem(List=readshapefile.Values, Index=Slider(7, range=0..10), Wrap=True)
panel_4 = Panel(item)

# ---- group: project footprint and extrude buildings
area = Area(Geometry=readshapefile_3.Geometry)  # -> Area, Centroid
project = Project(Geometry=readshapefile.Geometry, Plane=area.Centroid)  # -> graft(Geometry), Transform
boundary_3 = BoundarySurfaces(Edges=project.Geometry)
Z = UnitZ(Factor=item_2)
buildings = Extrude(Base=boundary_3, Direction=Z)

# ---- group: extruding blocks
curb_height = Slider(6, range=0..10)
Z_2 = UnitZ(Factor=curb_height)
blocks = Extrude(Base=sdiff, Direction=Z_2)

# ----
streets = Surface(boundary_2)

# ---- group: geometry in branches
entwine = Entwine(Branch00=flatten(buildings), Branch01=blocks, Branch02=streets, FlattenInputs=True)

# ---- group: bake with attributes
toggle_3 = BooleanToggle(False)
bake_with_attributes = BakeWithAttributes(geometry=entwine, layers=data, colors=wheel, materials=makematerial.Material, delete=toggle_3, Bake=toggle_3)
