# Grasshopper definition pickle_data.gh (Grasshopper 1.0.7)
# plug-ins: SelectLayerfromGeoJSON

toggle = BooleanToggle(True)

# ---- group: road import
load_road_shapefile = FilePath("C:\Dropbox\MIT\LOCAL\gh_ex\working\unpickle_data\shapefiles\BASEMAP_Roads.shp")

# ---- group: analysis boundary import
load_boundary_shapefile = FilePath("C:\Dropbox\MIT\LOCAL\gh_ex\working\unpickle_data\shapefiles\MIT_buffer.shp")

# ---- group: building footprint import
load_footprint_shapefile = FilePath("C:\Dropbox\MIT\LOCAL\gh_ex\working\unpickle_data\shapefiles\BASEMAP_Buildings.shp")

# ----
readshapefile = ReadShapefile(shapefile=load_road_shapefile, Read=toggle)  # -> Geometry, Attributes, Values
readshapefile_2 = ReadShapefile(shapefile=load_boundary_shapefile, Read=toggle)  # -> Geometry, Attributes, Values
readshapefile_3 = ReadShapefile(shapefile=load_footprint_shapefile, Read=toggle)  # -> Geometry, Attributes, Values

# ---- group: making surfaces for blocks
boundary = BoundarySurfaces(Edges=readshapefile_2.Geometry)
boundary_2 = BoundarySurfaces(Edges=readshapefile.Geometry)
sdiff = SolidDifference(BrepsA=boundary, BrepsB=boundary_2)

# ---- group: extracting height parameter
flip = FlipMatrix(Data=readshapefile_3.Attributes)
item = ListItem(List=flip, Index=0, Wrap=True)  # -> flatten(Item)
panel = Panel(item)
item_2 = ListItem(List=readshapefile_3.Values, Index=Slider(7, range=0..10), Wrap=True)

# ---- group: project footprint and extrude buildings
area = Area(Geometry=readshapefile_2.Geometry)  # -> Area, Centroid
project = Project(Geometry=readshapefile_3.Geometry, Plane=area.Centroid)  # -> graft(Geometry), Transform
boundary_3 = BoundarySurfaces(Edges=project.Geometry)
Z = UnitZ(Factor=item_2)
buildings = Extrude(Base=boundary_3, Direction=Z)

# ---- group: extruding blocks
curb_height = Slider(6, range=0..10)
Z_2 = UnitZ(Factor=curb_height)
blocks = Extrude(Base=sdiff, Direction=Z_2)

# ----
streets = Surface(boundary_2)

# ---- group: layer names
panel_2 = Panel("buildings")
panel_3 = Panel("blocks")
panel_4 = Panel("streets")

# ---- group: geometry in branches
entwine = Entwine(Branch00=buildings, Branch01=blocks, Branch02=streets, FlattenInputs=True)

# ---- group: PICKLING GEOMETRIES
toggle_set_true = BooleanToggle(True)
merge = Merge(Data1=panel_2, Data2=panel_3, Data3=panel_4)

# ----
input_path = FilePath("C:\Dropbox\MIT\LOCAL\gh_ex\working\unpickle_data\")
pickledata = PickleData(data=entwine, siteNumber=Slider(1, range=0..1), layers=merge, path=input_path, write=toggle_set_true)
