# Grasshopper definition pickle_view.gh (Grasshopper 1.0.7)
# plug-ins: SelectLayerfromGeoJSON

toggle = BooleanToggle(True)
load_boundary_shapefile = FilePath("C:\Dropbox\MIT\LOCAL\gh_ex\working\pickle_unpickle_view\shapefiles\MIT_buffer.shp")
load_footprint_shapefile = FilePath("C:\Dropbox\MIT\LOCAL\gh_ex\working\pickle_unpickle_view\shapefiles\BASEMAP_Buildings.shp")
load_road_shapefile = FilePath("C:\Dropbox\MIT\LOCAL\gh_ex\working\pickle_unpickle_view\shapefiles\BASEMAP_Roads.shp")
readshapefile = ReadShapefile(shapefile=load_road_shapefile, Read=toggle)  # -> Geometry, Attributes, Values
readshapefile_2 = ReadShapefile(shapefile=load_boundary_shapefile, Read=toggle)  # -> Geometry, Attributes, Values
readshapefile_3 = ReadShapefile(shapefile=load_footprint_shapefile, Read=toggle)  # -> Geometry, Attributes, Values

# ---- group: making surfaces for blocks
boundary = BoundarySurfaces(Edges=flatten(readshapefile.Geometry))
boundary_2 = BoundarySurfaces(Edges=readshapefile_2.Geometry)
sdiff = SolidDifference(BrepsA=boundary_2, BrepsB=boundary)

# ---- group: extracting height parameter
flip = FlipMatrix(Data=readshapefile_3.Attributes)
item = ListItem(List=flip, Index=0, Wrap=True)  # -> flatten(Item)
panel = Panel(item)
item_2 = ListItem(List=readshapefile_3.Values, Index=Slider(7, range=0..10), Wrap=True)

# ---- group: project footprint and extrude buildings
area = Area(Geometry=readshapefile_2.Geometry)  # -> Area, Centroid
project = Project(Geometry=readshapefile_3.Geometry, Plane=area.Centroid)  # -> graft(Geometry), Transform
boundary_3 = BoundarySurfaces(Edges=project.Geometry)
Z = UnitZ(Factor=item_2)
buildings = Extrude(Base=boundary_3, Direction=Z)

# ---- group: extruding blocks
curb_height = Slider(6, range=0..10)
Z_2 = UnitZ(Factor=curb_height)
blocks = Extrude(Base=sdiff, Direction=Z_2)

# ----
streets = Surface(boundary)

# ---- group: geometry in branches
entwine = Entwine(Branch00=buildings, Branch01=blocks, Branch02=streets, FlattenInputs=True)

# ---- group: create and set view
toggle_2 = BooleanToggle(True)
path = FilePath("C:\Dropbox\MIT\LOCAL\gh_ex\WEBSITE\pickle_unpickle_view\")
createpickleview = CreatePickleView(
    geometries=entwine,
    azimuth=Slider(59, range=0..100),
    altitude=Slider(19, range=0..100),
    fileName="cambridge_piece_3d",
    path=path,
    Write=toggle_2)  # -> Geometry, View_vector, View_target, Status
setview = SetView(
    setView=toggle_2,
    geometry=createpickleview.Geometry,
    target=createpickleview.View_target,
    vector=createpickleview.View_vector)
