# Grasshopper definition unpickle_view.gh (Grasshopper 1.0.7)
# plug-ins: SelectLayerfromGeoJSON

toggle = BooleanToggle(True)
path = FilePath("C:\Dropbox\MIT\LOCAL\gh_ex\WEBSITE\pickle_unpickle_view\")
unpickleview = UnPickleView(layer="cambridge_piece_3d", path=path, read=toggle)  # -> Geometry, Vector, Target, Status
setview = SetView(setView=toggle, geometry=unpickleview.Geometry, target=unpickleview.Target, vector=unpickleview.Vector)
