# Grasshopper definition read_shp.gh (Grasshopper 1.0.7)
# plug-ins: SelectLayerfromGeoJSON

path = FilePath("C:\Dropbox\MIT\LOCAL\gh_ex\WEBSITE\read_shp\shapefiles\ENVIRONMENTAL_StreetTrees.shp")
readshapefile = ReadShapefile(shapefile=path, Read=Toggle(True))  # -> Geometry, Attributes, Values
panel = Panel(readshapefile.Attributes)
panel_2 = Panel(readshapefile.Values)
pt = Point(readshapefile.Geometry)
