# Grasshopper definition shp_extract.gh (Grasshopper 1.0.7)
# plug-ins: SetView

path = FilePath("G:\Dropbox\MIT\LOCAL\gh_ex\errors\shp_extract\top_10_business_legend.shp")
readshapefile = ReadShapefile(shapefile=path, Read=Toggle(True))
shpextractuserstring = SHPExtractUserStrings(Geometry=readshapefile)  # -> Attributes, Values
