# Grasshopper definition spatial_join.gh (Grasshopper 1.0.7)
# plug-ins: SelectLayerfromGeoJSON

# ---- group: containers
toggle = BooleanToggle(False)
toggle_2 = BooleanToggle(True)
land_use = FilePath("C:\Dropbox\MIT\LOCAL\gh_ex\WEBSITE\spatial_join\shapefiles\landuse_buffer.shp")

# ---- group: contained
toggle_3 = BooleanToggle(False)
toggle_4 = BooleanToggle(True)
impervious = FilePath("C:\Dropbox\MIT\LOCAL\gh_ex\WEBSITE\spatial_join\shapefiles\impervious_buffer.shp")

# ----
readshapefile = ReadShapefile(shapefile=impervious, Read=toggle_4)  # -> Geometry, Attributes, Values
readshapefile_2 = ReadShapefile(shapefile=land_use, Read=toggle_2)  # -> Geometry, Attributes, Values
spatial_join = SpatialJoin(
    Contained=readshapefile.Geometry,
    Containers=readshapefile_2.Geometry,
    ContainedAttributes=readshapefile.Attributes,
    ContainedValues=readshapefile.Values,
    ContainerAttributes=readshapefile_2.Attributes,
    ContainerValues=readshapefile_2.Values)  # -> SelectedContained, JoinedAttributes, JoinedValues
panel = Panel(spatial_join.JoinedAttributes)
panel_2 = Panel(readshapefile.Attributes)
