# Grasshopper definition unpickle_data.gh (Grasshopper 1.0.7)
# plug-ins: SelectLayerfromGeoJSON

# ---- group: layer names
panel = Panel("buildings")
panel_2 = Panel("blocks")
panel_3 = Panel("streets")

# ----
path = FilePath("C:\Dropbox\MIT\LOCAL\gh_ex\WEBSITE\unpickle_data\")

# ---- group: unpickle data
merge = Merge(Data1=panel, Data2=panel_2, Data3=panel_3)
toggle = BooleanToggle(True)

# ----
unpickledata = UnPickleData(siteNumber=Slider(1, range=0..1), layers=merge, path=path, read=toggle)
panel_4 = Panel(unpickledata)
