# Grasshopper definition write_shp.gh (Grasshopper 1.0.7)
# plug-ins: SelectLayerfromGeoJSON

geometry_input = Curve(graft([<curve referenced from the Rhino model> x87]))

# ---- group: get z value
explode = Explode(Curve=geometry_input, Recursive=True)  # -> Segments, Vertices
pdecon = Deconstruct(Point=explode.Vertices)  # -> XComponent, YComponent, ZComponent
item = ListItem(List=pdecon.ZComponent, Index=0, Wrap=True)

# ---- group: NAME FILE
panel = Panel("terrain_shp")

# ---- group: label fields
panel_2 = Panel("height")

# ---- group: WRITE SHP
toggle = BooleanToggle(True)
path = FilePath("C:\Dropbox\MIT\LOCAL\gh_ex\WEBSITE\write_shp\")

# ----
path_2 = FilePath("C:\Dropbox\MIT\LOCAL\gh_ex\WEBSITE\write_shp\lynn_proj.prj")
write_shp = WriteSHP(
    geometry=flatten(geometry_input),
    fields=panel_2,
    values=item,
    path=path,
    filename=panel,
    Activate=toggle,
    projection=path_2)
